# Grasshopper definition createSimpleBoxCase.gh (Grasshopper 0.9.76)
# plug-ins: Python Interpreter

python = PythonScript(butterflyFolder="C:/Users/Administrator/Dropbox/ladybug/Butterfly")  # -> out
# ---------- python: Python ----------
import sys
sys.path.append(butterflyFolder)

try:
    import butterfly
    print "imported buttefly! swoosh swoosh..."
except ImportError:
    raise "Incorrect butterfly folder. Failed to import butterfly!"
# ---------- end python ----------

# ---- group: I don't know what to call these
python_2 = PythonScript(Cmu=0.09, kappa=0.4, E=9.8)  # -> epsilonWallFunction
# ---------- python_2: Python ----------
import sys
sys.path.append("C:/Users/Administrator/Dropbox/ladybug/Butterfly")
from butterfly.fields import EpsilonWallFunction

epsilonWallFunction = EpsilonWallFunction(value, Cmu, kappa, E)
# ---------- end python_2 ----------
python_3 = PythonScript()  # -> nutkWallFunction
# ---------- python_3: Python ----------
import sys
sys.path.append("C:/Users/Administrator/Dropbox/ladybug/Butterfly")
from butterfly.fields import NutkWallFunction

nutkWallFunction = NutkWallFunction(value, Cmu, kappa, E)
# ---------- end python_3 ----------
python_4 = PythonScript(value="0.01")  # -> kqRWallFunction
# ---------- python_4: Python ----------
import sys
sys.path.append("C:/Users/Administrator/Dropbox/ladybug/Butterfly")
from butterfly.fields import KqRWallFunction

if value:
    kqRWallFunction = KqRWallFunction(value)
# ---------- end python_4 ----------
python_5 = PythonScript(value="(0 0 0)")  # -> fixedValue
# ---------- python_5: Python ----------
import sys
sys.path.append("C:/Users/Administrator/Dropbox/ladybug/Butterfly")
from butterfly.fields import FixedValue

if value:
    fixedValue = FixedValue(value)
# ---------- end python_5 ----------
python_6 = PythonScript()  # -> zeroGradient
# ---------- python_6: Python ----------
import sys
sys.path.append("C:/Users/Administrator/Dropbox/ladybug/Butterfly")
from butterfly.fields import ZeroGradient

zeroGradient = ZeroGradient()
# ---------- end python_6 ----------
python_7 = PythonScript()  # -> calculated
# ---------- python_7: Python ----------
import sys
sys.path.append("C:/Users/Administrator/Dropbox/ladybug/Butterfly")
from butterfly.fields import Calculated

calculated = Calculated()
# ---------- end python_7 ----------

# ----
panel = Panel(python_2)
panel_2 = Panel(python)

# ---- group: create your own
python_8 = PythonScript(bcType="patch", U=python_6, p=python_6, k=python_6, epsilon=python_7, nut=python_7)  # -> out, boundaryFields
# ---------- python_8: Python ----------
import sys
sys.path.append("C:/Users/Administrator/Dropbox/ladybug/Butterfly")

import butterfly
from butterfly import boundarycondition
reload(butterfly)
reload(butterfly.boundarycondition)

if not bcType:
    bcType = 'patch'

boundaryFields = boundarycondition.BoundaryCondition(
    bcType, refLevels=None, u=U, p=p, k=k, epsilon=epsilon, nut=nut
)

boundaryFields = boundaryFields.duplicate()
# ---------- end python_8 ----------

# ----
vec = VectorXYZ(XComponent="2", YComponent=0, ZComponent=0)  # -> Vector, Length
wall = PythonScript(boundaryFields=python_8.boundaryFields)  # -> BC
# ---------- wall: Python ----------
import sys
sys.path.append("C:/Users/Administrator/Dropbox/ladybug/Butterfly")

import butterfly
from butterfly import boundarycondition as bc

if not refLevels:
    refLevels = (0, 0)

if not boundaryFields:
    BC = bc.BoundaryCondition('patch', refLevels=refLevels)
else:
    boundaryFields.refLevels = refLevels
    BC = boundaryFields.duplicate()
# ---------- end wall ----------
wall_2 = PythonScript(velocityVec=vec.Vector, refLevels="(5, 5)")  # -> inletBC; inputs velocityVec: Vector3d
# ---------- wall_2: Python ----------
import sys
sys.path.append("C:/Users/Administrator/Dropbox/ladybug/Butterfly")

import butterfly
from butterfly import boundarycondition as bc
from butterfly.fields import FixedValue
reload(butterfly)
reload(butterfly.boundarycondition)
#reload(butterfly.fields)

velocityVec = FixedValue(str(tuple(velocityVec)).replace(',', '')) \
              if velocityVec \
              else None

inletBC = bc.FixedInletBoundaryCondition(refLevels=refLevels, u=velocityVec)
# ---------- end wall_2 ----------
wall_3 = PythonScript(refLevels="(10, 10)")  # -> wallBC
# ---------- wall_3: Python ----------
import butterfly
from butterfly import boundarycondition

reload(butterfly)
reload(butterfly.boundarycondition)

wallBC = boundarycondition.IndoorWallBoundaryCondition(refLevels=refLevels)
# ---------- end wall_3 ----------
wall_4 = PythonScript(refLevels="(5, 5)")  # -> outletBC
# ---------- wall_4: Python ----------
import butterfly
from butterfly import boundarycondition as bc
from butterfly.fields import FixedValue

reload(butterfly)
reload(butterfly.boundarycondition)
pressure = FixedValue(pressure) if pressure else None
outletBC = bc.FixedOutletBoundaryCondition(refLevels=refLevels, p=pressure)
# ---------- end wall_4 ----------
jagged = SettingsSpeed()

# ---- group: inlet!
srf = Surface(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)

# ----
srf_2 = Surface(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)
brep = Brep(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)
area = Area(Geometry=srf)  # -> Area, Centroid
wires = BrepWireframe(Brep=brep, Density=-1)
vdis = VectorDisplay(Anchor=area.Centroid, Vector=vec.Vector)
preview = CustomPreview(Geometry=[srf_2, srf], Shader=ColourSwatch(SwatchColor=RGBA(136, 191, 255, 77)))
python_9 = PythonScript(geo=brep, name="room", BC=wall_3, meshSet=jagged)  # -> out, BFSrf; inputs geo: list of GeometryBase
# ---------- python_9: Python ----------
from butterfly.gh.bfsurface import BFSurface
if _geo and _name:
    BFSrf = BFSurface(_name, _geo, _BC_, _meshSet_)
# ---------- end python_9 ----------
python_10 = PythonScript(geo=srf, name="west_window", BC=wall_2, meshSet=jagged)  # -> out, BFSrf; inputs geo: list of GeometryBase; same code as python_9
python_11 = PythonScript(geo=srf_2, name="east_window", BC=wall_4, meshSet=jagged)  # -> out, BFSrf; inputs geo: list of GeometryBase; same code as python_9
python_12 = PythonScript(windwardX=3, topX=3, sidesX=2, leewardX=15, nDivXYZ="{30,5,10}", gradXYZ="{1,1,2}")  # -> out, tunnelPar; inputs nDivXYZ: Point3d, gradXYZ: Point3d
# ---------- python_12: Python ----------
from butterfly.windtunnel import TunnelParameters

tunnelPar = TunnelParameters(_windwardX_, _topX_, _sidesX_, _leewardX_,
                             _nDivXYZ_, _gradXYZ_)
# ---------- end python_12 ----------
panel_3 = Panel("""simulationType		RAS;


RAS
{

    printCoeffs		on;

    RASModel		RNGkEpsilon;
turbulance""")
wall_5 = PythonScript(refLevels="(1, 3)")  # -> wallBC
# ---------- wall_5: Python ----------
from butterfly import boundarycondition
wallBC = boundarycondition.IndoorWallBoundaryCondition(refLevels=_refLevels_)
# ---------- end wall_5 ----------
number_slider = Slider(10, range=0..10)
python_13 = PythonScript()
jagged_2 = SettingsSpeed()
brep_2 = Brep([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])
box = DomainBox(Base=PlaneXY(0, 0, 0), X=number_slider, Y=number_slider, Z=number_slider)

# ---- group: recipe
python_14 = PythonScript(_turbulenceModel_=python_13)  # -> Out, Recipe

# ----
python_15 = PythonScript(geo=brep_2, name="buildings", BC=wall_5, meshSet=jagged_2)  # -> out, BFSrf; inputs geo: list of GeometryBase; same code as python_9
preview_2 = CustomPreview(
    Geometry=brep_2,
    Shader={ambient=RGB(0, 0, 0), diffuse=RGB(255, 105, 180), emission=RGB(76, 32, 54), shine=0.5, specular=RGB(255, 255, 255), transparency=0})
python_16 = PythonScript(bbox=box, nDivXYZ="{5,5,5}", gradXYZ="{1,1,1}")  # -> blockMeshDict; inputs bbox: GeometryBase, nDivXYZ: Point3d, gradXYZ: Point3d
# ---------- python_16: Python ----------
# import butterfly
from butterfly.gh.bfsurface import BFSurface
from butterfly.gh.block import Block
from butterfly.blockMeshDict import BlockMeshDict
from butterfly.boundarycondition import BoundingBoxBoundaryCondition

# create blockMeshDict based on BBox
if _bbox:
    block = Block(_bbox, _nDivXYZ_, _gradXYZ_)
    bc = BoundingBoxBoundaryCondition()
    BBBFSurface = BFSurface('boundingbox', [_bbox], bc)
    blockMeshDict = BlockMeshDict(1, [BBBFSurface], [block])
# ---------- end python_16 ----------
# Add refinement regions here!
panel_4 = Panel("indoor_airflow_2")
dom = ConstructDomain(DomainStart="1", DomainEnd="2")
vec_2 = Vector(Vector(47.94345108, 59.67856447, 0))
vdis_2 = VectorDisplay(Anchor=Point(0, 0, 0), Vector=vec_2)

# ---- group: Create and write the case!
python_17 = PythonScript(
    name=panel_4,
    BFSurfaces=flatten([python_9.BFSrf, python_10.BFSrf, python_11.BFSrf]),
    blockMeshDict=python_16,
    globalRefLevel=dom)  # -> out, case; inputs BFSurfaces: list
# ---------- python_17: Python ----------
from butterfly.gh.core import Case

if _name and _BFSurfaces and _blockMeshDict: 
    # create OpenFoam Case
    case = Case(_name, _BFSurfaces, _blockMeshDict, _globalRefLevel_,
                _blockMeshDict.center, isSnappyHexMesh=True)
    
    case.createCaseFolders()
    case.populateContents()
# ---------- end python_17 ----------

# ----
python_18 = PythonScript(name="outdoors_test_2", BFSurfaces=python_15.BFSrf, windSpeed="2", landscape=1, tunnelPar=python_12.tunnelPar)  # -> readMe, geo, case; inputs BFSurfaces: list, windSpeed: Int32, windDirection: Vector3d, landscape: Int32
# ---------- python_18: Python ----------
from butterfly.gh.windtunnel import GHWindTunnel
#import butterfly
#reload(butterfly)
#reload(butterfly.core)
#reload(butterfly.foamfile)
#reload(butterfly.boundarycondition)
#reload(butterfly.windtunnel)
#reload(butterfly.gh.windtunnel)
#reload(butterfly.gh.core)

if _name and _BFSurfaces and _windSpeed:
    wt = GHWindTunnel(_name, _BFSurfaces, _windSpeed, _windDirection_, _tunnelPar_,
                      _landscape_, _globalRefLevel_)
    geo =  wt.boundingbox
    case = wt.toOpenFOAMCase()
    case.createCaseFolders()
    case.populateContents()
# ---------- end python_18 ----------
panel_5 = Panel(python_18.readMe)
python_19 = PythonScript(castellatedMesh=True, snap=True, addLayers=False, maxGlobalCells=2000000)  # -> snappyHexMeshDict; inputs meshQuality: Int32, castellatedMesh: Boolean, snap: Boolean, addLayers: Boolean, maxGlobalCells: Int32
# ---------- python_19: Python ----------
"""
Set parameters for snappyHexMeshDict.
Read more about snappyHexMeshDict here:
    https://openfoamwiki.net/images/f/f0/Final-AndrewJacksonSlidesOFW7.pdf


    Args:
        _meshQuality_: Use 0-2 to auto generate the parameters for meshQualityControls
        _castellatedMesh_: Set to True to castellated mesh (default: True).
        _snap_: Set to True to snap mesh to the surfaces (default: True).
        _addLayers_: Set to True to push mesh away from surfaces and add layers.
            (default: False)
        _maxGlobalCells_: An intger for the maximum number of global cells (default: 2000000).
    Returns:
        snappyHexMeshDict: Butterfly snappyHexMeshDict.
"""

import butterfly
from butterfly.snappyHexMeshDict import SnappyHexMeshDict
#reload(butterfly)
#reload(butterfly.foamfile)
#reload(butterfly.snappyHexMeshDict)

snappyDict = SnappyHexMeshDict()

if _meshQuality_:
    raise NotImplementedError('MeshQuality is not implemented yet. It will be added soon.')

snappyDict.castellatedMesh = _castellatedMesh_
snappyDict.snap = _snap_
snappyDict.addLayers = _addLayers_

if _maxGlobalCells_:
    snappyDict.maxGlobalCells = _maxGlobalCells_


if additionalParameters_:
    raise NotImplementedError('additionalParameters is not implemented yet. It will be added soon.')

snappyHexMeshDict = snappyDict
# ---------- end python_19 ----------

# ---- group: blockMesh
# Mesh non-orthogonality Max: 56.5827 average: 11.9441
python_20 = PythonScript(case=python_18.case, run=Toggle(False))  # -> out, case
# ---------- python_20: Python ----------
if _case and _run:
    # run blockMesh
    _case.blockMesh()
    case = _case
# ---------- end python_20 ----------

# ----
panel_6 = Panel(python_18.case)

brep_3 = Brep([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])
python_21 = PythonScript(geo=brep_3, nDivXYZ="{1,1,1}", gradXYZ="{1,1,1}")  # -> out, block; inputs geo: Brep, nDivXYZ: Point3d, gradXYZ: Point3d; disabled
# ---------- python_21: Python ----------
import sys
sys.path.append("C:/Users/Administrator/Dropbox/ladybug/Butterfly")

import butterfly
from butterfly.gh import Block

reload(butterfly)
reload(butterfly.gh)

block = Block(geo, nDivXYZ, gradXYZ)
# ---------- end python_21 ----------
wires_2 = BrepWireframe(Brep=brep_3, Density=-1)
python_22 = PythonScript(name="innerflow_2", blocks=python_21.block)  # -> out, c; inputs BFSrfs: list, blocks: list; disabled
# ---------- python_22: Python ----------
import sys
sys.path.append("C:/Users/Administrator/Dropbox/ladybug/Butterfly")

import butterfly
from butterfly.foamfile import FoamFile
from butterfly.core import Case

reload(butterfly)
reload(butterfly.blockMeshDict)
reload(butterfly.foamfile)
reload(butterfly.core)

c = Case.fromBlocks(BFSrfs, blocks, 1)
c.write(name)
# ---------- end python_22 ----------
panel_7 = Panel(python_22.out)

# ---- group: snappyHexMesh
meshguidepoint = PythonScript(case=python_20.case, snappyHexMeshDict=python_19, run=Toggle(False))  # -> out, case; inputs locationInMesh: Point3d
# ---------- meshguidepoint: Python ----------
if case:
    if not _locationInMesh_:
        _locationInMesh_ = case.blockMeshDict.center
    else:
        _locationInMesh_ = tuple(_locationInMesh_)

    if _snappyHexMeshDict_ and hasattr(_snappyHexMeshDict_, 'locationInMesh'):
        case.snappyHexMeshDict = _snappyHexMeshDict_
        
    case.snappyHexMeshDict.locationInMesh = _locationInMesh_
    case.snappyHexMeshDict.save(case.projectDir)
    if _run:
        case.snappyHexMesh()
# ---------- end meshguidepoint ----------

# ----
python_23 = PythonScript(startTime=0, endTime=Slider(500, range=0..1000), writeInterval=100, writeCompression=False)  # -> controlDict; inputs startTime: Int32, endTime: Int32, writeInterval: Int32, writeCompression: Boolean
# ---------- python_23: Python ----------
"""
Set parameters for runDict

    Args:
        _startTime_: Start timestep (default: 0)
        _endTime_: End timestep (default: 1000)
        _writeInterval_: Number of intervals between writing the results
            (default: 100)
        _writeCompression_: Set to True if you want the results to be compressed
            before being written to your machine (default: False).
    Returns:
        controlDict: Butterfly controlDict.
"""

import butterfly
from butterfly.controlDict import ControlDict
#reload(butterfly)
#reload(butterfly.foamfile)
#reload(butterfly.controlDict)

cd = ControlDict()
if _startTime_ is not None:
    cd.startTime = _startTime_

if _endTime_ is not None:
    cd.endTime = _endTime_

if _writeInterval_ is not None:
    cd.writeInterval = _writeInterval_

if _writeCompression_ is not None:
    cd.writeCompression = _writeCompression_

controlDict = cd
# ---------- end python_23 ----------

# ---- group: checkMesh
python_24 = PythonScript(Case=meshguidepoint.case, _run=Toggle(True))  # -> Out, Case

# ---- group: execute the case - simpleFoam for now
simplefoam = PythonScript(case=meshguidepoint.case, controlDict=python_23, run=Toggle(False))  # -> out, case
# ---------- simplefoam: Python ----------
if case:
    if _controlDict_ and hasattr(_controlDict_, 'startTime'):
        case.controlDict = _controlDict_
        case.controlDict.save(case.projectDir)

if case and run:
    case.copySnappyHexMesh()
    case.renameSnappyHexMeshFolders()
    case.simpleFoam()
    # rename the folders back
    case = case.renameSnappyHexMeshFolders()
# ---------- end simplefoam ----------

# ----
data = Data(meshguidepoint.case)
panel_8 = Panel(simplefoam.case)
python_25 = PythonScript(case=simplefoam.case, load=Toggle(False))  # -> velocityVectors; inputs load: Boolean
# ---------- python_25: Python ----------
if case and load:
    velocityVectors = case.loadVelocity()
# ---------- end python_25 ----------

panel_9 = Panel("C:\Users\Administrator\Dropbox\ladybug\Butterfly\other_files\OpenFOAM_Sample_Files\innerflow\constant\polyMesh")
python_26 = PythonScript(studyFolder="C:\Users\Administrator\butterfly\atrium2d\3\polyMesh")  # -> out, mesh
# ---------- python_26: Python ----------
import Rhino as rc
import os

def splitLine(l, t=float):
    return tuple(t(s) for s in l.split('(')[-1].replace(')', '').split())

def OFMeshToRhino(studyFolder):
    if not studyFolder:
        return

    pf = os.path.join(studyFolder, 'points')
    ff = os.path.join(studyFolder, 'faces')
    
    if not os.path.isfile(pf) or not os.path.isfile(ff):
        print "Can't find point and faces file."
        return
        
    # read points
    with open(pf, 'rb') as ptFile:
        for l in xrange(17):
            ptFile.readline()
        
        try:
            # blockMesh
            line = ptFile.readline()
            nPoints = int(line[0])
            pts = tuple(
                       rc.Geometry.Point3d(*pt)
                       for pt in eval(line[1:].replace(" ", ", "))
                       )
        except:
            #snappyHexMesh
            line = ptFile.readline()
            nPoints = int(line)
            ptFile.readline()
            pts = tuple(
                       rc.Geometry.Point3d(*splitLine(ptFile.readline()))
                       for pt in xrange(nPoints)
                )

            
    # read faces
    with open(ff, 'rb') as faceFile:
       for l in xrange(18):
           faceFile.readline()
       
       nFaces = int(faceFile.readline())
       faceFile.readline()
       faces = tuple((splitLine(faceFile.readline(), t=int))
                   for pt in xrange(nFaces)
            )
    
    # create the mesh
    mesh = rc.Geometry.Mesh()

    for p in pts:
        mesh.Vertices.Add(p)

    for face in faces:
        if len(face) < 5:
            mesh.Faces.AddFace(*face)
        elif len(face) == 5:
            mesh.Faces.AddFace(*face[:3])
            mesh.Faces.AddFace(*face[:1] + (face[3:]))
        elif len(face) == 8:
            mesh.Faces.AddFace(*face[:4])
            mesh.Faces.AddFace(*(face[0], face[3], face[4], face[7]))
            mesh.Faces.AddFace(*(face[7], face[4], face[5], face[6]))
        else:
            try:
                mesh.Faces.AddFace(*face[:4])
                mesh.Faces.AddFace(*face[:1] + (face[4:]))
            except:
                msg = "One of the faces has %d vertices." % len(face)
                print msg

    return mesh

mesh = OFMeshToRhino(studyFolder)
# ---------- end python_26 ----------
pt = Point(Point(5.246792205, 3.706414975, 3.184472171))
xz = XZPlane(Origin=pt)
xy = XYPlane(Origin=pt)
yz = YZPlane(Origin=pt)
mesh = Mesh(python_26.mesh)
sec = MeshPlane(Mesh=mesh, Plane=xy)

panel_10 = Panel("C:\Users\Administrator\butterfly\innerflow_3\constant\polyMesh")
python_27 = PythonScript(case=meshguidepoint.case, load=Toggle(False))  # -> pts; inputs load: Boolean
# ---------- python_27: Python ----------
if case and load:
    case.copySnappyHexMesh()
    pts = case.loadPoints()
# ---------- end python_27 ----------
python_28 = PythonScript(case=data, load=Toggle(True))  # -> mesh; inputs load: Boolean
# ---------- python_28: Python ----------
if case and load:
    case.copySnappyHexMesh()
    mesh = case.loadMesh()
# ---------- end python_28 ----------
pt_2 = Point(Point(4.878056299, 4.533652062, 2.405799131))
xz_2 = XZPlane(Origin=pt_2)
xy_2 = XYPlane(Origin=pt_2)
yz_2 = YZPlane(Origin=pt_2)
mesh_2 = Mesh(python_28)
sec_2 = MeshPlane(Mesh=mesh_2, Plane=xy_2)
panel_11 = Panel(python_26.out)
panel_12 = Panel("C:\Users\Administrator\butterfly\outdoor_0\constant\polyMesh")
python_29 = PythonScript(studyFolder="C:\Users\Administrator\butterfly\outdoor_0\300")  # -> vectors
# ---------- python_29: Python ----------
import Rhino as rc
import os

def splitLine(l, t=float):
    return tuple(t(s) for s in l.split('(')[-1].replace(')', '').split())


def loadVectors(studyFolder):
    pf = os.path.join(studyFolder, 'U')
    
    if not os.path.isfile(pf):
        print "Can't find vector file."
        return
        
    # read vectors
    with open(pf, 'rb') as ptFile:
        for l in xrange(21):
            line = ptFile.readline()       
        nVectors = int(line)
        ptFile.readline()
        vectors = tuple(
                   rc.Geometry.Vector3d(*splitLine(ptFile.readline()))
                   for pt in xrange(nVectors)
            )
    return vectors

vectors = loadVectors(studyFolder)
# ---------- end python_29 ----------
python_30 = PythonScript(studyFolder=panel_12)  # -> pts
# ---------- python_30: Python ----------
import Rhino as rc
import os

def splitLine(l, t=float):
    return tuple(t(s) for s in l.split('(')[-1].replace(')', '').split())


def loadPoints(studyFolder):
    pf = os.path.join(studyFolder, 'points')
    
    if not os.path.isfile(pf):
        print "Can't find point and faces file."
        return
        
    # read points
    with open(pf, 'rb') as ptFile:
        for l in xrange(17):
            ptFile.readline()
        
        try:
            # blockMesh
            line = ptFile.readline()
            nPoints = int(line[0])
            pts = tuple(
                       rc.Geometry.Point3d(*pt)
                       for pt in eval(line[1:].replace(" ", ", "))
                       )
        except:
            #snappyHexMesh
            line = ptFile.readline()
            nPoints = int(line)
            ptFile.readline()
            pts = tuple(
                       rc.Geometry.Point3d(*splitLine(ptFile.readline()))
                       for pt in xrange(nPoints)
                )

    return pts

pts = loadPoints(studyFolder)
# ---------- end python_30 ----------
panel_13 = Panel("result visualization")

pt_3 = Point(Point(5.817924118, 24.79410443, 10.17661724))
xz_3 = XZPlane(Origin=pt_3)
xy_3 = XYPlane(Origin=pt_3)
vec_3 = Vector(python_29)
pt_4 = Point(python_30)
num = Number("0.75")

yz_3 = YZPlane(Origin=pt_3)
pln = Plane(yz_3)

project = Project(Geometry=pt_4, Plane=pln)  # -> Geometry, Transform
dist = Distance(PointA=project.Geometry, PointB=pt_4)
smaller = SmallerThan(FirstNumber=dist, SecondNumber=num)  # -> SmallerThan, OrEqualTo
cull = CullPattern(List=vec_3, CullPattern=smaller.OrEqualTo)
vlen = VectorLength(Vector=cull)
bnd = Bounds(Numbers=vlen)
remap = RemapNumbers(Value=cull, Source=bnd, Target=Domain(1, 0))  # -> Mapped, Clipped
gradient = Gradient(
    LowerLimit=0,
    UpperLimit=1,
    Parameter=remap.Mapped,
    stops=[0: RGB(234, 38, 0), 0.25: RGB(234, 126, 0), 0.5: RGB(254, 244, 84), 0.75: RGB(173, 203, 249), 1: RGB(75, 107, 169)])
cull_2 = CullPattern(List=pt_4, CullPattern=smaller.OrEqualTo)
cull_3 = CullPattern(List=vec_3, CullPattern=smaller.OrEqualTo)
vdisex = VectorDisplayEx(Point=cull_2, Vector=cull_3, Colour=gradient, Width=Slider(1, range=0..1))

del = DelaunayMesh(Points=cull_2, Plane=pln)
mcol = MeshColours(Mesh=del, Colours=gradient)
