# Dynamo custom node Visualize Vectors.dyf (Dynamo 1.2.1.3083)
# category: Butterfly.07::PostProcess
# Visualize vectors

vectors = Input(_vectors: Vector[])  # list of vectors
length = Vector.Length(vectors)
scale = Input(scale_: double = 0.25)  # scale vector size
code_block = CodeBlock(value=length, scale=scale) { value * scale; }
legendPar = Input(_legendPar_: var = null)  # legend parameters. Find it under ladybug extras
generate_colors = Custom[Generate Colors](values=code_block, legendPar=legendPar)  # Color a test surface based on the results of a study. The results structure should match the test points structure to be mapped correctly on the surface.
ERRReport = Output(generate_colors.ERRReport)
startPts = Input(_startPts: Point[])  # list of start points
byStartPointDirectionLength = Line.ByStartPointDirectionLength(startPoint=startPts, direction=vectors, length=code_block)
scaleHead = Input(scaleHead_: double = 0.125)  # scale arrow heade
mul = code_block * scaleHead

# group: create arrow
code_block_2 = CodeBlock { 0.75; }
pointAtParameter = Curve.PointAtParameter(curve=byStartPointDirectionLength, param=code_block_2)
endPoint = Curve.EndPoint(byStartPointDirectionLength)
byPointsRadius = Cone.ByPointsRadius(pointAtParameter, endPoint, mul)

create = List.Create(byStartPointDirectionLength, byPointsRadius)
create_2 = List.Create(generate_colors.colors, generate_colors.colors)
byGeometryColor = Display.Display.ByGeometryColor(create, create_2)
Display = Output(byGeometryColor)
