# Dynamo graph outdoor_study.dyn (Dynamo 1.2.1.3083)

code_block = CodeBlock { x = 10; y = 20; z = 20; z / 2; }
byCoordinates = Point.ByCoordinates(z=code_block.out3)
XAxis = Vector.XAxis()
code_block_2 = CodeBlock { 1; }
make2d_parameters = Custom[Make2d Parameters](origin=byCoordinates, normal=XAxis, width=code_block_2)  # Make a case 2d.
code_block_3 = CodeBlock { "outdoor_study"; }
code_block_4 = CodeBlock { "building"; }
byLengths = Cuboid.ByLengths(origin=byCoordinates, width=code_block.x, length=code_block.x, height=code_block.z)
refinement_levels = CodeBlock { {2, 2}; }
create_butterfly_geometry = Custom[Create Butterfly Geometry](name=code_block_4, geo=byLengths, refineLevels=refinement_levels)  # Create Butterfly surface. -
code_block_5 = CodeBlock { 5; }
wind_vector = Custom[Wind Vector](windSpeed=code_block_5)  # Wind vector. -
wind_tunnel_parameters = Custom[Wind Tunnel Parameters]()  # Wind tunnel parameters. -
boolean = BoolSelector(true)
create_case_from_tunnel = Custom[Create Case from Tunnel](name=code_block_3, BFGeometries=create_butterfly_geometry.BFGeometries, windVector=wind_vector.windVector, tunnelParams=wind_tunnel_parameters.tunnelParams, run=boolean)  # Create Case from wind tunnel. -
code_block_6 = CodeBlock { 10; 10; 10; }
byCoordinates_2 = Point.ByCoordinates(x=code_block_6.out0, y=code_block_6.out1, z=code_block_6.out2)
boolean_2 = BoolSelector(false)
blockMesh = Custom[blockMesh](case=create_case_from_tunnel.case, cellSizeXYZ=byCoordinates_2, run=boolean_2)  # blockMesh -
boolean_3 = BoolSelector(false)
load_mesh = Custom[Load Mesh](case=blockMesh.case, load=boolean_3)  # Load mesh from the case for preview. -
watch = Watch(load_mesh.ERRReport)
boolean_4 = BoolSelector(false)
code_block_7 = CodeBlock { "castellatedMeshControls  {resolveFeatureAngle 95; }"; }
snappyHexMeshDict = Custom[snappyHexMeshDict](snap=boolean_4, additionalParameters=code_block_7)  # Set parameters for snappyHexMeshDict. Read more about snappyHexMeshDict here: https://openfoamwiki.net/images/f/f0/Final-AndrewJacksonSlidesOFW7.pdf
boolean_5 = BoolSelector(true)
snappyHexMesh = Custom[snappyHexMesh](case=blockMesh.case, snappyHexMeshDict=snappyHexMeshDict.snappyHexMeshDict, run=boolean_5)  # snappyHexMesh -
steady_incompressible_recipe = Custom[Steady Incompressible Recipe]()  # Steady Incompressible Recipe. -
code_block_8 = CodeBlock { 200; }
controlDict = Custom[controlDict](endTime=code_block_8)  # Set parameters for runDict
string_from_object = FromObject(controlDict.controlDict)
solution_parameters = Custom[Solution Parameters](controlDict=string_from_object)  # Solution Parameters.
boolean_6 = BoolSelector(true)
boolean_7 = BoolSelector(true)
solution = Custom[Solution](case=create_case_from_tunnel.case, recipe=steady_incompressible_recipe.recipe, solutionParams=solution_parameters.solutionParams, write=boolean_6, run=boolean_7)  # Run recipes using OpenFOAM. -
watch_2 = Watch(solution.residualValues)
watch_3 = Watch(solution.residualFields)
code_block_9 = CodeBlock { "peds"; "U"; }
code_block_10 = CodeBlock(x=create_case_from_tunnel.pts) { x[0..3]; true; }
byPoints = PolyCurve.ByPoints(points=code_block_10.out0, connectLastToFirst=code_block_10.out1)
code_block_11 = CodeBlock { 0.5; }
scale = Geometry.Scale(geometry=byPoints, amount=code_block_11)
byPatch = Surface.ByPatch(scale)
code_block_12 = CodeBlock { 0..1..#20; 0..1..#50; 2; }
pointAtParameter = Surface.PointAtParameter(surface=byPatch, u=code_block_12.out0, v=code_block_12.out1, lacing=CrossProduct)
byCoordinates_3 = Vector.ByCoordinates(z=code_block_12.out2)
translate = Geometry.Translate(geometry=pointAtParameter, direction=byCoordinates_3)
code_block_13 = CodeBlock { {0.045, 0.5 + 0.045}; }
pointAtParameter_2 = Curve.PointAtParameter(curve=scale, param=code_block_13)
byBestFitThroughPoints = Line.ByBestFitThroughPoints(pointAtParameter_2)
code_block_14 = CodeBlock { 30; }
byCoordinates_4 = Vector.ByCoordinates(z=code_block_14)
extrude = Curve.Extrude(byBestFitThroughPoints, byCoordinates_4)
code_block_15 = CodeBlock { 0..1..#20; 0..1..#60; }
pointAtParameter_3 = Surface.PointAtParameter(surface=extrude, u=code_block_15.out1, v=code_block_15.out0, lacing=CrossProduct)
create = List.Create(translate, pointAtParameter_3)
flatten = Flatten(create)
boolean_8 = BoolSelector(false)
sample_case = Custom[Sample Case](solution=solution.solution, name=code_block_9.out0, points=flatten, field=code_block_9.out1, run=boolean_8)  # Sample the results for a case. Use this component yo load the results for a case that you have ran already. -
code_block_16 = CodeBlock { 1.25; 0.1; }
code_block_17 = CodeBlock { 17; }
lb_color_range = Custom[LB Color Range](index=code_block_17)  # A set of color ranges for coloring analysis results
legend_parameters = Custom[Legend Parameters](colors=lb_color_range.colors)  # Use legend parameter to set up results visualization setting
visualize_vectors = Custom[Visualize Vectors](vectors=sample_case.values, startPts=sample_case.probes, scale=code_block_16.out0, scaleHead=code_block_16.out1, legendPar=legend_parameters.legendPar)  # Visualize vectors
boolean_9 = BoolSelector(false)
purgeCase = Custom[purgeCase](case=create_case_from_tunnel.case, results=boolean_9, postProcessing=boolean_9)  # Purge case folder. -
