# Grasshopper definition indoor_airflow.gh (Grasshopper 0.9.76)
# plug-ins: Python Interpreter

# ---- group: I don't know what to call these
epsilonwallfunction = Butterfly_epsilonWallFunction(Cmu=0.09, kappa=0.4, E=9.8)  # -> epsilonWallFunction; plug-in component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
nutkwallfunction = Butterfly_nutkWallFunction()  # -> nutkWallFunction; plug-in component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
kqrwallfunction = Butterfly_kqRWallFunction(value="0.01")  # -> kqRWallFunction; plug-in component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
fixedvalue = Butterfly_fixedValue(value="(0 0 0)")  # -> fixedValue; plug-in component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
calculated = Butterfly_calculated()  # -> calculated; plug-in component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
zerogradient = Butterfly_zeroGradient()  # -> zeroGradient; plug-in component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

# ----
# Create your own boundary
# from boundary conditions
panel = Panel("patch")
panel_2 = Panel(nutkwallfunction)

# ---- group: create your own
boundary = Butterfly_Boundary(bType=panel, U=zerogradient, p=zerogradient, k=zerogradient, epsilon=calculated, nut=calculated)  # -> readMe, boundary; plug-in component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

# ----
# 0. Create BF surfaces
panel_3 = Panel("2")
vec = VectorXYZ(XComponent=panel_3, YComponent=0, ZComponent=0)  # -> Vector, Length
inlet = Butterfly_InletBoundary(velocityVec=vec.Vector, refLevels="(5, 5)")  # -> inletBoundary; plug-in component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
wall = Butterfly_WallBoundary(refLevels="(3, 5)")  # -> wallBoundary; plug-in component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
outlet = Butterfly_OutletBoundary(refLevels="(5, 5)")  # -> outletBoundary; plug-in component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

# ---- group: inlet!
# Indoor Study
srf = Surface(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)

# ---- group: walls
brep = Brep(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)

# ---- group: outlet
srf_2 = Surface([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])

# ----
number_slider = Slider(10, range=0..10)
wires = BrepWireframe(Brep=brep, Density=-1)
area = Area(Geometry=srf)  # -> Area, Centroid
jagged = SettingsSpeed()
vdis = VectorDisplay(Anchor=area.Centroid, Vector=vec.Vector)
preview = CustomPreview(Geometry=[srf_2, srf], Shader=ColourSwatch(SwatchColor=RGBA(136, 191, 255, 77)))
box = DomainBox(Base=PlaneXY(0, 0, 0), X=number_slider, Y=number_slider, Z="7")
wires_2 = BrepWireframe(Brep=box, Density=-1)
createbfgeometry = Butterfly_CreateButterflyGeometry(geo=flatten(srf), name="west_window", boundary=inlet, meshSet=jagged)  # -> readMe, BFGeo; plug-in component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
createbfgeometry_2 = Butterfly_CreateButterflyGeometry(geo=flatten(brep), name="room", boundary=wall, meshSet=jagged)  # -> readMe, BFGeo; plug-in component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
createbfgeometry_3 = Butterfly_CreateButterflyGeometry(geo=flatten(srf_2), name="east_window", boundary=outlet, meshSet=jagged)  # -> readMe, BFGeo; plug-in component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
blockmeshdict = Butterfly_blockMeshDict(bbox=box, cellSizeXYZ="{3,2.5,2}")  # -> readMe, blockMeshDict; plug-in component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
preview_2 = CustomPreview(
    Geometry=wires_2,
    Shader={ambient=RGB(0, 0, 0), diffuse=RGB(255, 105, 180), emission=RGB(76, 32, 54), shine=0.5, specular=RGB(255, 255, 255), transparency=0})
panel_4 = Panel(blockmeshdict.readMe)
dom = ConstructDomain(DomainStart="1", DomainEnd="2")

# ---- group: Create and write the case!
# 1. Create the OpenFOAM case
casefromgeos = Butterfly_CreateCaseFromGeometries(
    name="indoor_airflow",
    BFGeometries=flatten([createbfgeometry.BFGeo, createbfgeometry_2.BFGeo, createbfgeometry_3.BFGeo]),
    blockMeshDict=blockmeshdict.blockMeshDict,
    globalRefLevel=dom,
    run=Toggle(True))  # -> readMe, case; plug-in component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

# ----
panel_5 = Panel(casefromgeos.readMe)
decomposepardict = Butterfly_decomposeParDict(mode=0, numOfCpus="2")  # -> decomposeParDict; plug-in component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
toggle = BooleanToggle(False)
# purgeCase
purgecase = Butterfly_purgeCase(case=casefromgeos.case, blockMesh=False, snappyHexMesh=False, results=toggle, postProcessing=toggle)  # -> readMe; plug-in component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

# ---- group: set up divSchemes to change dynamically during the run. The first order will be used up to timestep 100, and the second order will be used for the rest of the analysis. Not helpful based on the residual values.
gendivschemes = Butterfly_divSchemesLibrary(quality=Slider(1, range=0..1))  # -> divSchemes; plug-in component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
gendivschemes_2 = Butterfly_divSchemesLibrary(quality=Slider(0, range=0..1))  # -> divSchemes; plug-in component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
panel_6 = Panel(gendivschemes_2)
panel_7 = Panel(gendivschemes)
solutionparam = Butterfly_SolutionParameter(filename="fvSchemes", values=panel_6, tRange="0 To 100", replace=False)  # -> solutionParam; plug-in component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
solutionparam_2 = Butterfly_SolutionParameter(filename="fvSchemes", values=panel_7, tRange="101 To 5000", replace=False)  # -> solutionParam; plug-in component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

# ----
# 0. blockMesh
# 1. snappyHexMesh
toggle_2 = BooleanToggle(False)
snappyhexmeshdict = Butterfly_snappyHexMeshDict(castellatedMesh=True, snap=True, addLayers=False, maxGlobalCells=2000000)  # -> snappyHexMeshDict; plug-in component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
blockmesh = Butterfly_blockMesh(case=casefromgeos.case, purge=Toggle(True), run=toggle_2)  # -> readMe, case; plug-in component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
snappyhexmesh = Butterfly_snappyHexMesh(case=blockmesh.case, run=Toggle(False))  # -> readMe, case; plug-in component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
# 1.1. checkMesh
chekmesh = Butterfly_chekMesh(case=snappyhexmesh.case, run=Toggle(False))  # -> readMe, case, maxNonOrthogonality; plug-in component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
# Meshing
panel_8 = Panel(chekmesh.readMe)

panel_9 = Panel(blockmesh.readMe)

# ---- group: update inlet wind velocity
panel_10 = Panel("""boundaryField
{

west_window
    {

  
value		uniform (2.4 0.0 0.0);

}
}""")
solutionparam_3 = Butterfly_SolutionParameter(filename="U", values=panel_10, replace=False)  # -> solutionParam; plug-in component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

# ---- group: sample the box in 3D
bbox = BoundingBox(Content=brep, Plane=PlaneXY(0, 0, 0), UnionBox=True)  # -> Box, Box_2
range = Range(Domain=Domain(0.05, 0.95), Steps=10)
crossref = CrossReference(ListA=range, ListB=range, ListC=range, CrossMode=1)  # -> ListA, ListB, ListC
box_2 = EvaluateBox(Box=bbox.Box, UParameter=crossref.ListA, VParameter=crossref.ListB, WParameter=crossref.ListC)  # -> Plane, Point, Include

# ----
brep_2 = Brep([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])

# ---- group: case
data = Data(chekmesh.case)

# ----
gentestpts = Honeybee_GenerateTestPoints(testGeometry=brep_2, gridSize=Slider(0.5, range=0..1), distBaseSrf="0.05", moveTestMesh=Toggle(False))  # -> readMe, simplify(testPoints), simplify(ptsVectors), simplify(facesArea), simplify(mesh); plug-in component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
# Load mesh/points
toggle_3 = BooleanToggle(False)
loadmesh = Butterfly_LoadMesh(case=data, load=toggle_3)  # -> mesh; plug-in component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
loadpoints = Butterfly_LoadPoints(case=data, load=Toggle(False))  # -> pts; plug-in component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
faceb = FaceBoundaries(Mesh=loadmesh)
flatten = FlattenTree(Tree=gentestpts.testPoints, Path="{0}")
panel_11 = Panel("""U
p""")
controldict = Butterfly_controlDict(startTime=0, endTime="800", writeInterval="100", writeCompression=False)  # -> controlDict; plug-in component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
probes = Butterfly_probes(pts=flatten, fields=panel_11)  # -> probes; plug-in component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
residualcontrol = Butterfly_residualControl(p="0.0001", U="0.0001", k="0.0001", epsilon="0.0001")  # -> residualControl; plug-in component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
ras = Butterfly_RASTurbulanceModel(RASModel="kEpsilon", turbulence=True, printCoeffs=True)  # -> RAS; plug-in component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
# 2. Recipe
steadyincomp = Butterfly_SteadyIncompressibleRecipe(case=chekmesh.case, turbulenceProp=ras)  # -> readMe, recipe; plug-in component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
solutionparams = Butterfly_SolutionParameters(
    controlDict=controldict,
    residualControl=residualcontrol,
    probes=probes,
    additionalParams=[solutionparam, solutionparam_2, solutionparam_3])  # -> readMe, solutionParams; plug-in component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
decomposepardict_2 = Butterfly_decomposeParDict(mode=0, numOfCpus="2")  # -> decomposeParDict; plug-in component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
panel_12 = Panel(steadyincomp.recipe)
# 3. Solution
solution = Butterfly_Solution(
    recipe=steadyincomp.recipe,
    decomposeParDict=decomposepardict_2,
    solutionParams=solutionparams.solutionParams,
    interval="2",
    write=Toggle(False),
    run=Toggle(False))  # -> readMe, solution, isRunning, timestep, quantities, residuals, logFiles; plug-in component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
panel_13 = Panel("0.0001")
panel_14 = Panel("1000 to 1180")
panel_15 = Panel(solution.timestep)
watchprobes = Butterfly_WatchProbes(solution=solution.solution, field="p")  # -> values; plug-in component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
watchprobes_2 = Butterfly_WatchProbes(solution=solution.solution, field="U")  # -> values; plug-in component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
panel_16 = Panel(solution.readMe)
tracker = ValueTracker(
    solution.residuals,
    TrackerAutoDomain=True,
    TrackerColour=RGB(255, 155, 0),
    TrackerPeriod=30,
    TrackerUpdate=25,
    TrackerDomain=[0, 1])
entwine = Entwine(Branch00=solution.quantities, Branch01=solution.residuals, FlattenInputs=True)  # -> simplify(Result)
rec = Rectangle({Plane=PlaneXY(-1, -13, 0), Size=Domain2(u=0..36, v=0..12)})
flip = FlipMatrix(Data=entwine)
plotresiduals = Butterfly_PlotResiduals(
    recipe=steadyincomp.recipe,
    rect=rec,
    targetRes=panel_13,
    lineWidth="0.05",
    method=Slider(0, range=0..1),
    load=Toggle(False))  # -> readMe, timeRange, curves, meshes, residualLine, colors; plug-in component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
join = TextJoin(Text=flip, Join=" ::")  # -> flatten(Result)
panel_17 = Panel(join)
end = EndPoints(Curve=plotresiduals.curves)  # -> Start, End
panel_18 = Panel(plotresiduals.timeRange)
panel_19 = Panel(plotresiduals.readMe)
preview_3 = CustomPreview(Geometry=plotresiduals.curves, Shader=plotresiduals.colors)
tag = TextTag3D(Location=end.Start, Text=plotresiduals.readMe, Size="0.5", Colour=plotresiduals.colors, Justification=6)

# ---- group: points
# Results visualization
pt = Point(flatten)

# ---- group: vectors
vec_2 = Vector(watchprobes_2)

# ----
vlen = VectorLength(Vector=vec_2)
bnd = Bounds(Numbers=vlen)
scale = Slider(0.27, range=0..1)
remap = RemapNumbers(Value=vlen, Source=bnd, Target=Domain(1, 0))  # -> Mapped, Clipped
gradient = Gradient(
    LowerLimit=0,
    UpperLimit=1,
    Parameter=remap.Mapped,
    stops=[0: RGB(234, 38, 0), 0.25: RGB(234, 126, 0), 0.5: RGB(254, 244, 84), 0.75: RGB(173, 203, 249), 1: RGB(75, 107, 169)])
multiplication = Multiplication(A=vec_2, B=scale)
vdisex = VectorDisplayEx(Point=pt, Vector=multiplication, Colour=gradient, Width=Slider(2, range=0..5))

flatten_2 = FlattenTree(Tree=gentestpts.mesh, Path="{0}")
mjoin = MeshJoin(Meshes=flatten_2)
recolormesh = Ladybug_RecolorMesh(analysisResult=watchprobes, inputMesh=mjoin, analysisTitle="p", legendTitle="Pa/m2")  # -> readMe, newMesh, newLegend, legendBasePt, meshColors, legendColors; plug-in component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
ladybug = Ladybug_Ladybug()  # -> Vviiiiiiiiiizzz; plug-in component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
