# Grasshopper definition indoor_airflow_temperature.gh (Grasshopper 0.9.76)
# plug-ins: Python Interpreter

wall = Butterfly_WallBoundary(temperature="100", refLevels="(2, 2)")  # -> wallBoundary; plug-in component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
wall_2 = Butterfly_WallBoundary(temperature="18", refLevels="(2, 2)")  # -> wallBoundary; plug-in component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

# ---- group: roof
srf = Surface(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)

# ---- group: walls
brep = Brep([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])

# ----
wires = BrepWireframe(Brep=brep, Density=-1)
# 0. CREATE BUTTERFLY SURFACES
preview = CustomPreview(Geometry=srf, Shader=ColourSwatch(SwatchColor=RGBA(136, 191, 255, 77)))
jagged = SettingsSpeed()
createbfgeometry = Butterfly_CreateButterflyGeometry(name="room", geo=flatten(brep), boundary=wall_2, meshSet=jagged)  # -> readMe, BFGeometries; plug-in component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
createbfgeometry_2 = Butterfly_CreateButterflyGeometry(name="roof", geo=flatten(srf), boundary=wall, meshSet=jagged)  # -> readMe, BFGeometries; plug-in component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
meshparams = Butterfly_MeshingParameters(cellSizeXYZ="{1, 1, 1}")  # -> readMe, meshPars; plug-in component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
# 1. CREATE OPENFOAM CASE
panel = Panel("convection_airflow")

# ---- group: Create and write the case!
casefromgeos = Butterfly_CreateCaseFromGeometries(
    name=panel,
    BFGeometries=flatten([createbfgeometry_2.BFGeometries, createbfgeometry.BFGeometries]),
    meshParams=meshparams.meshPars,
    run=Toggle(False))  # -> readMe, case; plug-in component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

# ----
panel_2 = Panel(casefromgeos.readMe)
toggle = BooleanToggle(False)
brep_2 = Brep(flatten([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]))
# PURGE CASE
purgecase = Butterfly_purgeCase(case=casefromgeos.case, blockMesh=False, snappyHexMesh=False, results=toggle, postProcessing=toggle)  # -> readMe; plug-in component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
gentestpts = Honeybee_GenerateTestPoints(testGeometry=brep_2, gridSize=Slider(0.5, range=0..1), distBaseSrf="0.05", moveTestMesh=Toggle(False))  # -> readMe, simplify(testPoints), simplify(ptsVectors), simplify(facesArea), simplify(mesh); plug-in component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
# 2.1. BLOCKMESH
blockmesh = Butterfly_blockMesh(case=casefromgeos.case, overwrite=True, run=Toggle(False))  # -> readMe, case; plug-in component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
flatten = FlattenTree(Tree=gentestpts.mesh, Path="{0}")
flatten_2 = FlattenTree(Tree=gentestpts.testPoints, Path="{0}")
panel_3 = Panel("""T
U""")
controldict = Butterfly_controlDict(startTime=0, endTime=Slider(2000, range=0..10000), writeInterval=Slider(250, range=0..1000), writeCompression=False)  # -> controlDict; plug-in component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
# 2. MESHING
# 2.2. SNAPPYHEXMESH
snappyhexmesh = Butterfly_snappyHexMesh(case=blockmesh.case, run=Toggle(False))  # -> readMe, case; plug-in component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
# PROBES
probes = Butterfly_probes(pts=flatten_2, fields=panel_3)  # -> probes; plug-in component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
solutionparams = Butterfly_SolutionParameters(controlDict=controldict, probes=probes)  # -> solutionParams; plug-in component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
# HEAT TRANSFER RECIPE
heattransfer = Butterfly_HeatTransferRecipe()  # -> readMe, recipe; plug-in component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
# VISUALIZE MESH
toggle_2 = BooleanToggle(False)
loadmesh = Butterfly_LoadMesh(case=snappyhexmesh.case, load=toggle_2)  # -> mesh; plug-in component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
# 3. SOLUTION
solution = Butterfly_Solution(
    case=snappyhexmesh.case,
    recipe=heattransfer.recipe,
    solutionParams=solutionparams,
    interval=2,
    write=Toggle(False),
    run=Toggle(False))  # -> readMe, solution, isRunning, timestep, residualFields, residualValues, logFiles; plug-in component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
panel_4 = Panel(solution.readMe)
panel_5 = Panel(solution.residualFields)
panel_6 = Panel(solution.residualValues)
loadprobesvalue = Butterfly_LoadProbesValue(solution=solution.solution, field="T")  # -> values; plug-in component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
loadprobesvalue_2 = Butterfly_LoadProbesValue(solution=solution.solution, field="U")  # -> values; plug-in component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
rec = Rectangle({Plane=PlaneXY(1, -6, 0), Size=Domain2(u=0..15, v=0..5)})

# ---- group: points
pt = Point(flatten_2)

# ----
# PLOT RESIDUALS
plotresiduals = Butterfly_PlotResiduals(solution=solution.solution, rect=rec, targetRes=0.0001, port=0.1, method=0, load=Toggle(False))  # -> readMe, timeRange, curves, port, residualLine, colors; plug-in component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

# ---- group: vectors
vec = Vector(loadprobesvalue_2)

# ----
mjoin = MeshJoin(Meshes=flatten)
preview_2 = CustomPreview(Geometry=plotresiduals.curves, Shader=plotresiduals.colors)
panel_7 = Panel(plotresiduals.readMe)
gradientlibrary = Ladybug_GradientLibrary(gradIndex="18")  # -> customColors; plug-in component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
legendpar = Ladybug_LegendParameters(customColors=flatten(gradientlibrary))  # -> legendPar; plug-in component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
# 4. RESULT VISUALIZATION
panel_8 = Panel("273.15")
subtraction = Subtraction(A=loadprobesvalue, B=panel_8)
bnd = Bounds(Numbers=subtraction)
panel_9 = Panel(bnd)
ladybug = Ladybug_Ladybug()  # -> Vviiiiiiiiiizzz; plug-in component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
recolormesh = Ladybug_RecolorMesh(analysisResult=subtraction, inputMesh=mjoin, legendPar=legendpar, analysisTitle="Temp.", legendTitle="C")  # -> readMe, newMesh, newLegend, legendBasePt, meshColors, legendColors; plug-in component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

scale = Slider(1, range=0..1)
multiplication = Multiplication(A=vec, B=scale)
vdisex = VectorDisplayEx(Point=pt, Vector=multiplication, Colour=recolormesh.meshColors, Width=Slider(2, range=0..5))

faceb = FaceBoundaries(Mesh=recolormesh.newMesh)
mesh = Mesh(recolormesh.newLegend)
preview_3 = CustomPreview(Geometry=faceb, Shader=recolormesh.meshColors)
